% Simulink data dictionary vehicleData.sldd

make = Simulink.Parameter("BMW", DataType="string")
model = Simulink.Parameter("5 Series", DataType="string")
year = Simulink.Parameter(2021, DataType="int32")
weight = Simulink.Parameter(1845, DataType="double", Unit="kg")
length = Simulink.Parameter(4936, DataType="double", Unit="mm")
width = Simulink.Parameter(1868, DataType="double", Unit="mm")
height = Simulink.Parameter(1466, DataType="double", Unit="mm")
wheelbase = Simulink.Parameter(2975, DataType="double", Unit="mm")
track_width_front = Simulink.Parameter(1587, DataType="double", Unit="mm")
track_width_rear = Simulink.Parameter(1587, DataType="double", Unit="mm")
center_of_gravity_height = Simulink.Parameter(550, DataType="double", Unit="mm")
distance_to_pitch_center_front = Simulink.Parameter(1487, DataType="double", Unit="mm")
distance_to_pitch_center_rear = Simulink.Parameter(1488, DataType="double", Unit="mm")
front_left = Simulink.Parameter(0, DataType="double", Unit="mm")
front_right = Simulink.Parameter(0, DataType="double", Unit="mm")
rear_left = Simulink.Parameter(0, DataType="double", Unit="mm")
rear_right = Simulink.Parameter(0, DataType="double", Unit="mm")